# Dynamo graph Cable Bridge.dyn (Dynamo 2.19.3.6394)

integer_slider = IntegerSlider(5, range=0..100 step 1)
integer_slider_2 = IntegerSlider(17, range=0..100 step 1)
integer_slider_3 = IntegerSlider(51, range=0..100 step 1)

# group: Railings
code_block = CodeBlock(n=integer_slider) { n+2; }
byCoordinates = Point.ByCoordinates(x=code_block, y=integer_slider_2)
XZ = Plane.XZ()
mirror = Geometry.Mirror(geometry=byCoordinates, mirrorPlane=XZ)
byCoordinates_2 = Point.ByCoordinates(x=integer_slider)
byThreePoints = Arc.ByThreePoints(firstPoint=mirror, secondPoint=byCoordinates_2, thirdPoint=byCoordinates)
code_block_2 = CodeBlock { 1; 0.5; 0.3; }
translate = Geometry.Translate(geometry=byThreePoints, xTranslation=code_block_2.out2, zTranslation=code_block_2.out1)
translate_2 = Geometry.Translate(geometry=byThreePoints, zTranslation=code_block_2.out0)
list_create = List.Create(item0=byThreePoints, item1=translate, item2=translate_2)
code_block_3 = CodeBlock(n=integer_slider_3) { 0..1..#n; }
pointAtParameter = Curve.PointAtParameter(curve=list_create, param=code_block_3, lacing=CrossProduct)
transpose = List.Transpose(lists=pointAtParameter)
byPoints = NurbsCurve.ByPoints(points=transpose)
list_create_2 = List.Create(item0=list_create, item1=byPoints)
YZ = Plane.YZ()
mirror_2 = Geometry.Mirror(geometry=list_create_2, mirrorPlane=YZ)

# group: Floor
code_block_4 = CodeBlock(n=integer_slider_3) { 0.2..0.8..#n; }
pointAtParameter_2 = Curve.PointAtParameter(curve=byThreePoints, param=code_block_4, lacing=CrossProduct)
mirror_3 = Geometry.Mirror(geometry=pointAtParameter_2, mirrorPlane=YZ)
byStartPointEndPoint = Line.ByStartPointEndPoint(startPoint=pointAtParameter_2, endPoint=mirror_3)
code_block_5 = CodeBlock(n=integer_slider) { 0..1..#n*3; }
pointAtParameter_3 = Curve.PointAtParameter(curve=byStartPointEndPoint, param=code_block_5, lacing=CrossProduct)
transpose_2 = List.Transpose(lists=pointAtParameter_3)
byPoints_2 = NurbsCurve.ByPoints(points=transpose_2)

integer_slider_4 = IntegerSlider(2, range=-10..10 step 1)
integer_slider_5 = IntegerSlider(32, range=0..90 step 1)

# group: Circle
byCoordinates_3 = Point.ByCoordinates(y=integer_slider_4)
code_block_6 = CodeBlock { 10; 30; }
YAxis = Vector.YAxis()
byCenterPointRadiusNormal = Circle.ByCenterPointRadiusNormal(centerPoint=byCoordinates_3, radius=code_block_6.out0, normal=YAxis)
XAxis = Vector.XAxis()
rotate = Geometry.Rotate(geometry=byCenterPointRadiusNormal, origin=byCoordinates_3, axis=XAxis, degrees=integer_slider_5)
code_block_7 = CodeBlock(n=integer_slider_3) { 1.25..0.75..#n; 0.25; }
pointAtParameter_4 = Curve.PointAtParameter(curve=rotate, param=code_block_7.out0)
byStartPointEndPoint_2 = Line.ByStartPointEndPoint(startPoint=pointAtParameter_4, endPoint=mirror_3)
code_block_8 = CodeBlock(n=integer_slider_3) { 0.25..0.75..#n; 0.25; }
pointAtParameter_5 = Curve.PointAtParameter(curve=rotate, param=code_block_8.out0)
byStartPointEndPoint_3 = Line.ByStartPointEndPoint(startPoint=pointAtParameter_5, endPoint=pointAtParameter_2)
