# Dynamo graph Home.dyn (Dynamo 2.19.3.6394)

integer_slider = IntegerSlider(7, range=0..100 step 1)
byCenterPointRadius = Circle.ByCenterPointRadius(radius=integer_slider)
integer_slider_2 = IntegerSlider(20, range=0..100 step 1)
code_block = CodeBlock(n=integer_slider_2) { 0..1-(1/n)..#n; }
pointAtParameter = Curve.PointAtParameter(curve=byCenterPointRadius, param=code_block)
integer_slider_3 = IntegerSlider(6, range=0..15 step 1)
shiftIndices = List.ShiftIndices(list=pointAtParameter, amount=integer_slider_3)
integer_slider_4 = IntegerSlider(24, range=0..100 step 1)
byCoordinates = Point.ByCoordinates(z=integer_slider_4)
byCenterPointRadius_2 = Circle.ByCenterPointRadius(centerPoint=byCoordinates, radius=integer_slider)
pointAtParameter_2 = Curve.PointAtParameter(curve=byCenterPointRadius_2, param=code_block)
byStartPointEndPoint = Line.ByStartPointEndPoint(startPoint=shiftIndices, endPoint=pointAtParameter_2, lacing=Shortest)
code_block_2 = CodeBlock(a=integer_slider_3) { -a; }
shiftIndices_2 = List.ShiftIndices(list=pointAtParameter, amount=code_block_2)
byStartPointEndPoint_2 = Line.ByStartPointEndPoint(startPoint=shiftIndices_2, endPoint=pointAtParameter_2)
list_create = List.Create(item0=byStartPointEndPoint, item1=byStartPointEndPoint_2)
planeAtParameter = Curve.PlaneAtParameter(curve=list_create)
code_block_3 = CodeBlock { 0.1; }
byPlaneRadius = Circle.ByPlaneRadius(plane=planeAtParameter, radius=code_block_3)
bySweep = Solid.BySweep(profile=byPlaneRadius, path=list_create)
integer_slider_5 = IntegerSlider(11, range=0..15 step 1)
pitch_number = IntegerSlider(5, range=0..15 step 1)
code_block_4 = CodeBlock(a=pitch_number) { a*100; }
code_block_5 = CodeBlock(H=integer_slider_4, n=code_block_4) { 0..H..#n; }
byCoordinates_2 = Point.ByCoordinates(z=code_block_5)
code_block_6 = CodeBlock { 10; }
translate = Geometry.Translate(geometry=byCoordinates_2, yTranslation=code_block_6)
byCoordinates_3 = Point.ByCoordinates()
ZAxis = Vector.ZAxis()
code_block_7 = CodeBlock(a=pitch_number, n=code_block_4) { 0..a*360..#n; }
rotate = Geometry.Rotate(geometry=translate, origin=byCoordinates_3, axis=ZAxis, degrees=code_block_7)
byStartPointEndPoint_3 = Line.ByStartPointEndPoint(startPoint=rotate, endPoint=byCoordinates_2)
code_block_8 = CodeBlock { 20; }
code_block_9 = CodeBlock(n=code_block_8) { 0..1..#n; }
pointAtParameter_3 = Curve.PointAtParameter(curve=byStartPointEndPoint, param=code_block_9, lacing=CrossProduct)
transpose = List.Transpose(lists=pointAtParameter_3)
byBestFitThroughPoints = Circle.ByBestFitThroughPoints(points=transpose)
byLoft = Surface.ByLoft(crossSections=byBestFitThroughPoints)
intersect = Geometry.Intersect(geometry=byStartPointEndPoint_3, other=byLoft)
byTwoPoints = Vector.ByTwoPoints(start=intersect, end=byCoordinates_2)
code_block_10 = CodeBlock { 0.5; 1; }
translate_2 = Geometry.Translate(geometry=intersect, direction=byTwoPoints, distance=code_block_10.out0)
flatten = List.Flatten(list=translate_2)
translate_3 = Geometry.Translate(geometry=translate_2, direction=byTwoPoints, distance=code_block_10.out1)
flatten_2 = List.Flatten(list=translate_3)
list_create_2 = List.Create(item0=flatten, item1=flatten_2)
byPoints = NurbsCurve.ByPoints(points=list_create_2)
byLoft_2 = Surface.ByLoft(crossSections=byPoints)
code_block_11 = CodeBlock { -0.1; }
boolean = BoolSelector(false)
thicken = Surface.Thicken(surface=byLoft_2, thickness=code_block_11, both_sides=boolean)
code_block_12 = CodeBlock { 0.2; }
extrude = Curve.Extrude(curve=byPoints, distance=code_block_12)
thicken_2 = Surface.Thicken(surface=extrude, thickness=code_block_11, both_sides=boolean)
planeAtParameter_2 = Curve.PlaneAtParameter(curve=list_create)
code_block_13 = CodeBlock { 0.1; }
byPlaneRadius_2 = Circle.ByPlaneRadius(plane=planeAtParameter_2, radius=code_block_13)
bySweep_2 = Solid.BySweep(profile=byPlaneRadius_2, path=list_create)
byPatch = Surface.ByPatch(closedCurve=byCenterPointRadius)
thicken_3 = Surface.Thicken(surface=byPatch, thickness=code_block_11, both_sides=boolean)
byPatch_2 = Surface.ByPatch(closedCurve=byCenterPointRadius_2)
thicken_4 = Surface.Thicken(surface=byPatch_2, thickness=code_block_11, both_sides=boolean)
