# Dynamo graph Tower.dyn (Dynamo 3.3.0.6316)

# group: Circles
code_block = CodeBlock { 0..4; 5; }
byCoordinates = Point.ByCoordinates(z=code_block.out0)
code_block_2 = CodeBlock { 3..1..#5; }
byCenterPointRadius = Circle.ByCenterPointRadius(centerPoint=byCoordinates, radius=code_block_2)
byCoordinates_2 = Point.ByCoordinates(z=code_block.out1)
byOriginNormal = Plane.ByOriginNormal(origin=byCoordinates_2)
mirror = Geometry.Mirror(geometry=byCenterPointRadius, mirrorPlane=byOriginNormal)
list_create = List.Create(item0=mirror, item1=byCenterPointRadius)
byPatch = Surface.ByPatch(closedCurve=list_create)

firstItem = List.FirstItem(list=byCenterPointRadius)
integer_slider = IntegerSlider(25, range=0..100 step 1)
code_block_3 = CodeBlock(n=integer_slider) { 0..1-(1/n)..#n; }
pointAtParameter = Curve.PointAtParameter(curve=firstItem, param=code_block_3)
code_block_4 = CodeBlock { 0.05; }
byCenterPointRadius_2 = Circle.ByCenterPointRadius(centerPoint=pointAtParameter, radius=code_block_4)
mirror_2 = Geometry.Mirror(geometry=pointAtParameter, mirrorPlane=byOriginNormal)
code_block_5 = CodeBlock { 10; }
shiftIndices = List.ShiftIndices(list=mirror_2, amount=code_block_5)
byStartPointEndPoint = Line.ByStartPointEndPoint(startPoint=pointAtParameter, endPoint=shiftIndices)
boolean = BoolSelector(true)
sweepAsSolid = Curve.SweepAsSolid(curve=byCenterPointRadius_2, path=byStartPointEndPoint, cutEndOff=boolean)
pointAtParameter_2 = Curve.PointAtParameter(curve=firstItem, param=code_block_3)
mirror_3 = Geometry.Mirror(geometry=pointAtParameter_2, mirrorPlane=byOriginNormal)
code_block_6 = CodeBlock { 10; }
shiftIndices_2 = List.ShiftIndices(list=mirror_3, amount=code_block_6)
byStartPointEndPoint_2 = Line.ByStartPointEndPoint(startPoint=pointAtParameter_2, endPoint=shiftIndices_2)
sweepAsSolid_2 = Curve.SweepAsSolid(curve=byCenterPointRadius_2, path=byStartPointEndPoint_2, cutEndOff=boolean)
